# Dynamo graph panda.dyn (Dynamo 2.0.2.6826)

code_block = CodeBlock { {"one's":[1,11,111,11,1],"two's":[2,22,222,22,2],"three's":[3,33,333,33,3],"four's":[4,44,444,44,4]}; }
code_block_2 = CodeBlock { {"model":["Lisa","Lisa 2","Macintosh 128K","Macintosh 512K"],"launched":[1983,1984,1984,1984],"discontinued":[1986,1985,1984,1986]}; }
file_path = Filename(".\movies.xls")
code_block_3 = CodeBlock { "2010s"; }

# group: Create Dataframe
byDictionary = DynamoPandas.Pandas.DataFrame.ByDictionary(dataDictionary=code_block_2)
code_block_4 = CodeBlock(x=byDictionary) { x; }  # frozen
dataFrameJson = DynamoPandas.Pandas.DataFrame.DataFrameJson(dataFrame=code_block_4)
tabulate = DynamoPandas.Format.DataFrameFormatters.Tabulate(dataframe=byDictionary)
toDictionary = DynamoPandas.Pandas.DataFrame.ToDictionary(dataFrame=code_block_4)
byExcel = DynamoPandas.Pandas.DataFrame.ByExcel(filePath=file_path, sheetName=code_block_3)
tabulate_2 = DynamoPandas.Format.DataFrameFormatters.Tabulate(dataframe=byExcel)  # frozen

# group: Filters
code_block_5 = CodeBlock { "s"; 1; }
byContains = DynamoPandas.FilterDataframe.Filter.ByContains(dataframe=code_block_4, item=code_block_5.out0, axis=code_block_5.out1)
tabulate_3 = DynamoPandas.Format.DataFrameFormatters.Tabulate(dataframe=byContains)
code_block_6 = CodeBlock { ["model","launched"]; 1; }
byItems = DynamoPandas.FilterDataframe.Filter.ByItems(dataframe=code_block_4, items=code_block_6.out0, axis=code_block_6.out1)
tabulate_4 = DynamoPandas.Format.DataFrameFormatters.Tabulate(dataframe=byItems)

# group: Select Rows
code_block_7 = CodeBlock { "model"; "Lisa"; }
byMatch = DynamoPandas.Select.SelectRows.ByMatch(dataframe=code_block_4, column=code_block_7.out0, matchString=code_block_7.out1)
tabulate_5 = DynamoPandas.Format.DataFrameFormatters.Tabulate(dataframe=byMatch)
code_block_8 = CodeBlock { "model"; "is"; }
byContains_2 = DynamoPandas.Select.SelectRows.ByContains(dataframe=code_block_4, column=code_block_8.out0, containsString=code_block_8.out1)
tabulate_6 = DynamoPandas.Format.DataFrameFormatters.Tabulate(dataframe=byContains_2)

tabulate_7 = DataframeFormatNodeModel(Dataframe=byExcel)
code_block_9 = CodeBlock()
# ---------- code_block_9.designscript (2 lines) ----------
["model","launched","discontinued"];
[["Lisa","Lisa 2","Macintosh 128K","Macintosh 512K"],[1983,1984,1984,1984],[1986,1985,1984,1986]];
# ----------------------------------------
byKeysValues = DesignScript.Builtin.Dictionary.ByKeysValues(keys=code_block_9.out0, values=code_block_9.out1)
